# Grasshopper definition worldFacade.gh (Grasshopper 1.0.7)
# plug-ins: Pufferfish, LunchBoxML, LunchBox

ülke_sayısı = Slider(25, range=0..155)

# ---- group: LB_ReadCSV
path = FilePath("C:\Users\Monster\Desktop\BTMT\2019.csv")
file = ReadFile(File=path, PerLineParse=True)
csv = ReadCSV(CSVString=file, Delimiter=",")  # -> Headers, Values
panel = Panel(csv.Headers)
panel_2 = Panel(csv.Values)
datagrid = CreateDataGrid(DataGridHeaders=panel, ValueTree=panel_2)

# ----
x_aralık = Slider(2, range=0..10)
series = Series(Start=0, Step=Slider(6, range=0..10), Count=ülke_sayısı)
dom = ConstructDomain(DomainStart=0, DomainEnd=x_aralık)
boşluk_y = Slider(2, range=0..10)
boşluk_z = Slider(2, range=0..10)
subset = SubList(List=panel, Domain=Domain(2, 8), Wrap=True)  # -> List, Index
lng = ListLength(List=flatten(panel_2))
series_2 = Series(Start=0, Step=boşluk_y, Count=ülke_sayısı)
series_3 = Series(Start=0, Step=boşluk_z, Count=7)
division = Division(A=lng, B=9)
pt = ConstructPoint(XCoordinate=0, YCoordinate=-3, ZCoordinate=series_3)
series_4 = Series(Start=0, Step=1, Count=division)

# ---- group: Data only Select
num = Number(series)
ülkeler = TreeItem(Tree=panel_2, Path="{1}", Index=num, Wrap=True)
puan = TreeItem(Tree=panel_2, Path="{2}", Index=num, Wrap=True)
gsyih = TreeItem(Tree=panel_2, Path="{3}", Index=num, Wrap=True)
sosyal_destek = TreeItem(Tree=panel_2, Path="{4}", Index=num, Wrap=True)
sağlıklı_yaşam_bek = TreeItem(Tree=panel_2, Path="{5}", Index=num, Wrap=True)
seçim_yapma_özgürlüğü = TreeItem(Tree=panel_2, Path="{6}", Index=num, Wrap=True)
cömertlik = TreeItem(Tree=panel_2, Path="{7}", Index=num, Wrap=True)
yolsuzluk_algıları = TreeItem(Tree=panel_2, Path="{8}", Index=num, Wrap=True)

# ----
tag = TextTag(Location=pt, Text=subset.List, Colour=RGB(0, 0, 0))

# ---- group: Data All
ülkeler_2 = TreeItem(Tree=panel_2, Path="{1}", Index=series_4, Wrap=True)
puan_2 = TreeItem(Tree=panel_2, Path="{2}", Index=series_4, Wrap=True)
gsyih_2 = TreeItem(Tree=panel_2, Path="{3}", Index=series_4, Wrap=True)
sosyal_destek_2 = TreeItem(Tree=panel_2, Path="{4}", Index=series_4, Wrap=True)
sağlıklı_yaşam_bek_2 = TreeItem(Tree=panel_2, Path="{5}", Index=series_4, Wrap=True)
mms = GhPythonScript(Veri=sosyal_destek_2)  # -> yeniVeri; inputs Veri: list
# ---------- mms: Python ----------
Min=min(Veri)
Max=max(Veri)
yeniVeri=[]
for i in Veri:
    q=(i-Min)/(Max-Min)
    yeniVeri.append(q)
# ---------- end mms ----------
mms_2 = GhPythonScript(Veri=sağlıklı_yaşam_bek_2)  # -> yeniVeri; inputs Veri: list; same code as mms
mms_3 = GhPythonScript(Veri=puan_2)  # -> yeniVeri; inputs Veri: list; same code as mms
mms_4 = GhPythonScript(Veri=gsyih_2)  # -> yeniVeri; inputs Veri: list; same code as mms
seçim_yapma_özgürlüğü_2 = TreeItem(Tree=panel_2, Path="{6}", Index=series_4, Wrap=True)
cömertlik_2 = TreeItem(Tree=panel_2, Path="{7}", Index=series_4, Wrap=True)
yolsuzluk_algıları_2 = TreeItem(Tree=panel_2, Path="{8}", Index=series_4, Wrap=True)
mms_5 = GhPythonScript(Veri=yolsuzluk_algıları_2)  # -> yeniVeri; inputs Veri: list; same code as mms
mms_6 = GhPythonScript(Veri=cömertlik_2)  # -> yeniVeri; inputs Veri: list; same code as mms
mms_7 = GhPythonScript(Veri=seçim_yapma_özgürlüğü_2)  # -> yeniVeri; inputs Veri: list; same code as mms

# ----
pt_2 = ConstructPoint(XCoordinate=0, YCoordinate=series_2, ZCoordinate=-2)
tag_2 = TextTag(Location=pt_2, Text=ülkeler, Colour=RGB(0, 0, 0))
subtraction = Subtraction(A=ülke_sayısı, B=1)
range = Range(Domain=Domain(0, 100), Steps=subtraction)
division_2 = Division(A=range, B=100)
bnd = Bounds(Numbers=puan)
bnd_2 = Bounds(Numbers=gsyih)
bnd_3 = Bounds(Numbers=sosyal_destek)
bnd_4 = Bounds(Numbers=cömertlik)
bnd_5 = Bounds(Numbers=seçim_yapma_özgürlüğü)
bnd_6 = Bounds(Numbers=yolsuzluk_algıları)
bnd_7 = Bounds(Numbers=sağlıklı_yaşam_bek)
remap = RemapNumbers(Value=puan, Source=bnd, Target=dom)  # -> Mapped, Clipped
remap_2 = RemapNumbers(Value=gsyih, Source=bnd_2, Target=dom)  # -> Mapped, Clipped
remap_3 = RemapNumbers(Value=sosyal_destek, Source=bnd_3, Target=dom)  # -> Mapped, Clipped
remap_4 = RemapNumbers(Value=cömertlik, Source=bnd_4, Target=dom)  # -> Mapped, Clipped
remap_5 = RemapNumbers(Value=seçim_yapma_özgürlüğü, Source=bnd_5, Target=dom)  # -> Mapped, Clipped
remap_6 = RemapNumbers(Value=yolsuzluk_algıları, Source=bnd_6, Target=dom)  # -> Mapped, Clipped
remap_7 = RemapNumbers(Value=sağlıklı_yaşam_bek, Source=bnd_7, Target=dom)  # -> Mapped, Clipped
item = ListItem(List=series_3, Index=1, Wrap=True)
item_2 = ListItem(List=series_3, Index=2, Wrap=True)
item_3 = ListItem(List=series_3, Index=3, Wrap=True)
item_4 = ListItem(List=series_3, Index=4, Wrap=True)
item_5 = ListItem(List=series_3, Index=5, Wrap=True)
item_6 = ListItem(List=series_3, Index=6, Wrap=True)
item_7 = ListItem(List=series_3, Index=0, Wrap=True)
pt_3 = ConstructPoint(XCoordinate=remap_6.Mapped, YCoordinate=series_2, ZCoordinate=item_6)
pt_4 = ConstructPoint(XCoordinate=remap_2.Mapped, YCoordinate=series_2, ZCoordinate=item)
pt_5 = ConstructPoint(XCoordinate=remap_3.Mapped, YCoordinate=series_2, ZCoordinate=item_2)
pt_6 = ConstructPoint(XCoordinate=remap_7.Mapped, YCoordinate=series_2, ZCoordinate=item_3)
pt_7 = ConstructPoint(XCoordinate=remap_5.Mapped, YCoordinate=series_2, ZCoordinate=item_4)
pt_8 = ConstructPoint(XCoordinate=remap_4.Mapped, YCoordinate=series_2, ZCoordinate=item_5)
pt_9 = ConstructPoint(XCoordinate=remap.Mapped, YCoordinate=series_2, ZCoordinate=item_7)
entwine = Entwine(
    Branch00=pt_9,
    Branch01=pt_4,
    Branch02=pt_5,
    Branch03=pt_6,
    Branch04=pt_7,
    Branch05=pt_8,
    Branch06=pt_3,
    FlattenInputs=True)
intcrv = Interpolate(Vertices=entwine, Degree=3, Periodic=False, KnotStyle=1)  # -> flatten(Curve), Length, Domain
loft = Loft(Curves=intcrv.Curve, Options={Adjust=False, Closed=False, LoftEnds=0, LoftSimp=0, LoftType=0, Rebuild=10, Refit=0.01})
input = Number(mms_4)
output = Number(mms_2)
input_2 = Number(mms_3)
output_2 = Number(mms)
input_3 = Number(mms_3)
output_3 = Number(mms_2)
input_4 = Number(mms_3)
output_4 = Number(mms_7)
input_5 = Number(mms_3)
output_5 = Number(mms_6)
input_6 = Number(mms_3)
output_6 = Number(mms_5)
multiplication = Multiplication(A=output, B=100)
multiplication_2 = Multiplication(A=output_2, B=100)
multiplication_3 = Multiplication(A=input, B=100)
multiplication_4 = Multiplication(A=input_2, B=100)
multiplication_5 = Multiplication(A=output_3, B=100)
multiplication_6 = Multiplication(A=input_3, B=100)
multiplication_7 = Multiplication(A=output_4, B=100)
multiplication_8 = Multiplication(A=output_5, B=100)
multiplication_9 = Multiplication(A=output_6, B=100)
multiplication_10 = Multiplication(A=input_4, B=100)
multiplication_11 = Multiplication(A=input_5, B=100)
multiplication_12 = Multiplication(A=input_6, B=100)

# ---- group: LB_CreatePanel
diamond = DiamondPanels(Surface=loft, UDivisions=6, VDivisions=ülke_sayısı)  # -> DiamondPanels, TriPanels
squads = SkewedQuads(Surface=loft, UDivisions=6, VDivisions=ülke_sayısı, TParameter=0)  # -> FullPanels, EdgePanels
trib = TrianglePanelsB(Surface=loft, UDivisions=6, VDivisions=ülke_sayısı)
quadstag = StaggeredQuadPanels(Surface=loft, UDivisions=6, VDivisions=ülke_sayısı)
quads = QuadPanels(Surface=loft, UDivisions=6, VDivisions=ülke_sayısı)

# ----
panel_3 = Panel("Linear Regression")
linereg = LinearRegression(TestData=range, TrainingInputs=multiplication_3, TrainingOutput=multiplication, RandomSeed=5)
linereg_2 = LinearRegression(TestData=range, TrainingInputs=multiplication_4, TrainingOutput=multiplication_2, RandomSeed=5)
linereg_3 = LinearRegression(TestData=range, TrainingInputs=multiplication_6, TrainingOutput=multiplication_5, RandomSeed=5)
linereg_4 = LinearRegression(TestData=range, TrainingInputs=multiplication_10, TrainingOutput=multiplication_7, RandomSeed=5)
linereg_5 = LinearRegression(TestData=range, TrainingInputs=multiplication_11, TrainingOutput=multiplication_8, RandomSeed=5)
linereg_6 = LinearRegression(TestData=range, TrainingInputs=multiplication_12, TrainingOutput=multiplication_9, RandomSeed=5)

pt_10 = ConstructPoint(XCoordinate=0, YCoordinate=range, ZCoordinate=linereg)
pt_11 = ConstructPoint(XCoordinate=0, YCoordinate=range, ZCoordinate=linereg_2)
pt_12 = ConstructPoint(XCoordinate=0, YCoordinate=multiplication_3, ZCoordinate=multiplication)
pt_13 = ConstructPoint(XCoordinate=0, YCoordinate=multiplication_4, ZCoordinate=multiplication_2)
pt_14 = ConstructPoint(XCoordinate=0, YCoordinate=range, ZCoordinate=linereg_3)
pt_15 = ConstructPoint(XCoordinate=0, YCoordinate=multiplication_6, ZCoordinate=multiplication_5)
pt_16 = ConstructPoint(XCoordinate=0, YCoordinate=range, ZCoordinate=linereg_4)
pt_17 = ConstructPoint(XCoordinate=0, YCoordinate=multiplication_10, ZCoordinate=multiplication_7)
pt_18 = ConstructPoint(XCoordinate=0, YCoordinate=range, ZCoordinate=linereg_5)
pt_19 = ConstructPoint(XCoordinate=0, YCoordinate=multiplication_11, ZCoordinate=multiplication_8)
pt_20 = ConstructPoint(XCoordinate=0, YCoordinate=range, ZCoordinate=linereg_6)
pt_21 = ConstructPoint(XCoordinate=0, YCoordinate=multiplication_12, ZCoordinate=multiplication_9)
item_8 = ListItem(List=pt_12, Index=series, Wrap=True)
item_9 = ListItem(List=pt_13, Index=series, Wrap=True)
item_10 = ListItem(List=pt_15, Index=series, Wrap=True)
item_11 = ListItem(List=pt_17, Index=series, Wrap=True)
item_12 = ListItem(List=pt_19, Index=series, Wrap=True)
item_13 = ListItem(List=pt_21, Index=series, Wrap=True)
pline = PolyLine(Vertices=pt_10, Closed=False)
crv_cp = CurveClosestPoint(Point=item_8, Curve=pline)  # -> Point, Parameter, Distance
pline_2 = PolyLine(Vertices=pt_11, Closed=False)
crv_cp_2 = CurveClosestPoint(Point=item_9, Curve=pline_2)  # -> Point, Parameter, Distance
pline_3 = PolyLine(Vertices=pt_14, Closed=False)
crv_cp_3 = CurveClosestPoint(Point=item_10, Curve=pline_3)  # -> Point, Parameter, Distance
pline_4 = PolyLine(Vertices=pt_16, Closed=False)
crv_cp_4 = CurveClosestPoint(Point=item_11, Curve=pline_4)  # -> Point, Parameter, Distance
pline_5 = PolyLine(Vertices=pt_18, Closed=False)
crv_cp_5 = CurveClosestPoint(Point=item_12, Curve=pline_5)  # -> Point, Parameter, Distance
pline_6 = PolyLine(Vertices=pt_20, Closed=False)
crv_cp_6 = CurveClosestPoint(Point=item_13, Curve=pline_6)  # -> Point, Parameter, Distance
data = Data(puan_2)
merge = Merge(
    Data1=crv_cp.Distance,
    Data2=crv_cp_2.Distance,
    Data3=crv_cp_3.Distance,
    Data4=crv_cp_4.Distance,
    Data5=crv_cp_5.Distance,
    Data6=crv_cp_6.Distance)
multiplication_13 = Multiplication(A=gsyih_2, B=Slider(1, range=0.7..2))
multiplication_14 = Multiplication(A=sağlıklı_yaşam_bek_2, B=Slider(1, range=0.7..2))
multiplication_15 = Multiplication(A=seçim_yapma_özgürlüğü_2, B=Slider(1.01, range=0.7..2))
multiplication_16 = Multiplication(A=sosyal_destek_2, B=Slider(1.15, range=0.7..2))
remap0_5 = GhPythonScript(Liste=merge)  # -> yeniListe; inputs Liste: list
# ---------- remap0_5: Python ----------
def reMap(value, maxInput, minInput, maxOutput, minOutput):

	value = maxInput if value > maxInput else value
	value = minInput if value < minInput else value

	inputSpan = maxInput - minInput
	outputSpan = maxOutput - minOutput

	scaledThrust = float(value - minInput) / float(inputSpan)

	return minOutput + (scaledThrust * outputSpan)
yeniListe=[]
for i in Liste:
    q=reMap(i,max(Liste),min(Liste),0.9,0.5)
    yeniListe.append(q)
# ---------- end remap0_5 ----------
frame = PanelFrame(Panel=quads, ScaleFactor=remap0_5)  # -> PanelFrame, Panel
srf = Surface(frame.PanelFrame)
srf_2 = Surface(frame.Panel)
offsrf = OffsetSurface(Surface=srf, Distance=0.1, BothSides=True, CreateSolid=True)  # -> flatten(Offset)
offsrf_2 = OffsetSurface(Surface=srf_2, Distance=0.05, BothSides=True, CreateSolid=True)  # -> flatten(Offset)
frame_2 = GhPythonScript(L=offsrf, E=ülke_sayısı)  # -> L0, L1, L2, L3, L4, L5; inputs L: list, E: Int32
# ---------- frame_2: Python ----------
L0=L[0:E]
L1=L[E:(2*E)]
L2=L[(2*E):(3*E)]
L3=L[(3*E):(4*E)]
L4=L[(4*E):(5*E)]
L5=L[(5*E):(6*E)]
# ---------- end frame_2 ----------
panel_4 = GhPythonScript(L=offsrf_2, E=ülke_sayısı)  # -> L0, L1, L2, L3, L4, L5; inputs L: list, E: Int32; same code as frame_2

# ---- group: Data f Clustering / D0 f Clustering
entwine_2 = Entwine(Branch00=data, Branch01=multiplication_13, FlattenInputs=True)
flip = FlipMatrix(Data=entwine_2)

# ---- group: Data f Clustering / D1 f Clustering
entwine_3 = Entwine(Branch00=data, Branch01=multiplication_16, FlattenInputs=True)
flip_2 = FlipMatrix(Data=entwine_3)

# ---- group: Data f Clustering / D2 f Clustering
entwine_4 = Entwine(Branch00=data, Branch01=multiplication_14, FlattenInputs=True)
flip_3 = FlipMatrix(Data=entwine_4)

# ---- group: Data f Clustering / D3 f Clustering
entwine_5 = Entwine(Branch00=data, Branch01=multiplication_15, FlattenInputs=True)
flip_4 = FlipMatrix(Data=entwine_5)

# ---- group: Data f Clustering / D4 f Clustering
entwine_6 = Entwine(Branch00=data, Branch01=cömertlik_2, FlattenInputs=True)
flip_5 = FlipMatrix(Data=entwine_6)

# ---- group: Data f Clustering / D5 f Clustering
entwine_7 = Entwine(Branch00=data, Branch01=yolsuzluk_algıları_2, FlattenInputs=True)
flip_6 = FlipMatrix(Data=entwine_7)

# ----
input_7 = Number(mms_3)
output_7 = Number(mms_4)
input_8 = Number(mms_3)
output_8 = Number(mms)
input_9 = Number(mms_3)
output_9 = Number(mms_2)
input_10 = Number(mms_3)
output_10 = Number(mms_6)
input_11 = Number(mms_3)
output_11 = Number(mms_7)
input_12 = Number(mms_3)
output_12 = Number(mms_5)
multiplication_17 = Multiplication(A=output_7, B=100)
multiplication_18 = Multiplication(A=input_7, B=100)
seed = Slider(0, range=-10..10)
cluster = Slider(6, range=0..10)
multiplication_19 = Multiplication(A=output_8, B=100)
multiplication_20 = Multiplication(A=input_8, B=100)
multiplication_21 = Multiplication(A=output_9, B=100)
multiplication_22 = Multiplication(A=input_9, B=100)
multiplication_23 = Multiplication(A=output_10, B=100)
multiplication_24 = Multiplication(A=input_10, B=100)
multiplication_25 = Multiplication(A=output_12, B=100)
multiplication_26 = Multiplication(A=output_11, B=100)
multiplication_27 = Multiplication(A=input_12, B=100)
multiplication_28 = Multiplication(A=input_11, B=100)

panel_5 = Panel("Nonlinear Regression")
nonlinereg = NonlinearRegression(
    TestData=graft(range),
    TrainingInputs=graft(multiplication_18),
    TrainingOutput=multiplication_17,
    Sigma=45,
    Complexity=75,
    RandomSeed=5)  # -> Result, Score, Error
nonlinereg_2 = NonlinearRegression(
    TestData=graft(range),
    TrainingInputs=graft(multiplication_20),
    TrainingOutput=multiplication_19,
    Sigma=45,
    Complexity=75,
    RandomSeed=5)  # -> Result, Score, Error
nonlinereg_3 = NonlinearRegression(
    TestData=graft(range),
    TrainingInputs=graft(multiplication_22),
    TrainingOutput=multiplication_21,
    Sigma=45,
    Complexity=75,
    RandomSeed=5)  # -> Result, Score, Error
nonlinereg_4 = NonlinearRegression(
    TestData=graft(range),
    TrainingInputs=graft(multiplication_28),
    TrainingOutput=multiplication_26,
    Sigma=45,
    Complexity=75,
    RandomSeed=5)  # -> Result, Score, Error
nonlinereg_5 = NonlinearRegression(
    TestData=graft(range),
    TrainingInputs=graft(multiplication_24),
    TrainingOutput=multiplication_23,
    Sigma=45,
    Complexity=75,
    RandomSeed=5)  # -> Result, Score, Error
nonlinereg_6 = NonlinearRegression(
    TestData=graft(range),
    TrainingInputs=graft(multiplication_27),
    TrainingOutput=multiplication_25,
    Sigma=45,
    Complexity=75,
    RandomSeed=5)  # -> Result, Score, Error

pt_22 = ConstructPoint(XCoordinate=0, YCoordinate=range, ZCoordinate=nonlinereg.Result)
pt_23 = ConstructPoint(XCoordinate=0, YCoordinate=range, ZCoordinate=nonlinereg_2.Result)
pt_24 = ConstructPoint(XCoordinate=0, YCoordinate=range, ZCoordinate=nonlinereg_3.Result)
pt_25 = ConstructPoint(XCoordinate=0, YCoordinate=range, ZCoordinate=nonlinereg_5.Result)
pt_26 = ConstructPoint(XCoordinate=0, YCoordinate=range, ZCoordinate=nonlinereg_6.Result)
pt_27 = ConstructPoint(XCoordinate=0, YCoordinate=multiplication_18, ZCoordinate=multiplication_17)
pt_28 = ConstructPoint(XCoordinate=0, YCoordinate=range, ZCoordinate=nonlinereg_4.Result)
pt_29 = ConstructPoint(XCoordinate=0, YCoordinate=multiplication_20, ZCoordinate=multiplication_19)
seed_2 = Number(seed)
pt_30 = ConstructPoint(XCoordinate=0, YCoordinate=multiplication_22, ZCoordinate=multiplication_21)
cluster_2 = Number(cluster)
pt_31 = ConstructPoint(XCoordinate=0, YCoordinate=multiplication_24, ZCoordinate=multiplication_23)
pt_32 = ConstructPoint(XCoordinate=0, YCoordinate=multiplication_27, ZCoordinate=multiplication_25)
pt_33 = ConstructPoint(XCoordinate=0, YCoordinate=multiplication_28, ZCoordinate=multiplication_26)
intcrv_2 = Interpolate(Vertices=pt_22, Degree=3, Periodic=False, KnotStyle=1)  # -> Curve, Length, Domain
item_14 = ListItem(List=pt_27, Index=series, Wrap=True)
intcrv_3 = Interpolate(Vertices=pt_23, Degree=3, Periodic=False, KnotStyle=1)  # -> Curve, Length, Domain
item_15 = ListItem(List=pt_29, Index=series, Wrap=True)
intcrv_4 = Interpolate(Vertices=pt_24, Degree=3, Periodic=False, KnotStyle=1)  # -> Curve, Length, Domain
intcrv_5 = Interpolate(Vertices=pt_25, Degree=3, Periodic=False, KnotStyle=1)  # -> Curve, Length, Domain
item_16 = ListItem(List=pt_30, Index=series, Wrap=True)
intcrv_6 = Interpolate(Vertices=pt_26, Degree=3, Periodic=False, KnotStyle=1)  # -> Curve, Length, Domain
intcrv_7 = Interpolate(Vertices=pt_28, Degree=3, Periodic=False, KnotStyle=1)  # -> Curve, Length, Domain
item_17 = ListItem(List=pt_31, Index=series, Wrap=True)
item_18 = ListItem(List=pt_32, Index=series, Wrap=True)
item_19 = ListItem(List=pt_33, Index=series, Wrap=True)
crv_cp_7 = CurveClosestPoint(Point=item_14, Curve=intcrv_2.Curve)  # -> Point, Parameter, Distance
crv_cp_8 = CurveClosestPoint(Point=item_15, Curve=intcrv_3.Curve)  # -> Point, Parameter, Distance
crv_cp_9 = CurveClosestPoint(Point=item_16, Curve=intcrv_4.Curve)  # -> Point, Parameter, Distance
crv_cp_10 = CurveClosestPoint(Point=item_17, Curve=intcrv_5.Curve)  # -> Point, Parameter, Distance
crv_cp_11 = CurveClosestPoint(Point=item_18, Curve=intcrv_6.Curve)  # -> Point, Parameter, Distance
crv_cp_12 = CurveClosestPoint(Point=item_19, Curve=intcrv_7.Curve)  # -> Point, Parameter, Distance

# ---- group: GMM
gaussianmix = GaussianMixture(TrainingInputs=flip_2, Components=cluster_2, RandomSeed=seed_2)  # -> Result, Likelihood, Probability
gaussianmix_2 = GaussianMixture(TrainingInputs=flip_3, Components=cluster_2, RandomSeed=seed_2)  # -> Result, Likelihood, Probability
gaussianmix_3 = GaussianMixture(TrainingInputs=flip, Components=cluster_2, RandomSeed=seed_2)  # -> Result, Likelihood, Probability
panel_6 = Panel("GMM")
gaussianmix_4 = GaussianMixture(TrainingInputs=flip_4, Components=cluster_2, RandomSeed=seed_2)  # -> Result, Likelihood, Probability
gaussianmix_5 = GaussianMixture(TrainingInputs=flip_5, Components=cluster_2, RandomSeed=seed_2)  # -> Result, Likelihood, Probability
gaussianmix_6 = GaussianMixture(TrainingInputs=flip_6, Components=cluster_2, RandomSeed=seed_2)  # -> Result, Likelihood, Probability

# ----
geo = Geometry(frame_2.L1)
geo_2 = Geometry(frame_2.L2)
geo_3 = Geometry(frame_2.L0)
geo_4 = Geometry(frame_2.L3)
geo_5 = Geometry(frame_2.L4)
geo_6 = Geometry(frame_2.L5)
remap255 = GhPythonScript(Liste=crv_cp_7.Distance)  # -> yeniListe; inputs Liste: list
# ---------- remap255: Python ----------
def reMap(value, maxInput, minInput, maxOutput, minOutput):

	value = maxInput if value > maxInput else value
	value = minInput if value < minInput else value

	inputSpan = maxInput - minInput
	outputSpan = maxOutput - minOutput

	scaledThrust = float(value - minInput) / float(inputSpan)

	return minOutput + (scaledThrust * outputSpan)
yeniListe=[]
for i in Liste:
    q=int(reMap(i,max(Liste),min(Liste),255,0))
    yeniListe.append(q)
# ---------- end remap255 ----------
remap255_2 = GhPythonScript(Liste=crv_cp_8.Distance)  # -> yeniListe; inputs Liste: list; same code as remap255
remap255_3 = GhPythonScript(Liste=crv_cp_9.Distance)  # -> yeniListe; inputs Liste: list; same code as remap255
remap255_4 = GhPythonScript(Liste=crv_cp_12.Distance)  # -> yeniListe; inputs Liste: list; same code as remap255
remap255_5 = GhPythonScript(Liste=crv_cp_10.Distance)  # -> yeniListe; inputs Liste: list; same code as remap255
remap255_6 = GhPythonScript(Liste=crv_cp_11.Distance)  # -> yeniListe; inputs Liste: list; same code as remap255
geo_7 = Geometry(pt_27)
number_slider = Slider(255, range=0..1000)
geo_8 = Geometry(item_14)

# ---- group: K-Means
panel_7 = Panel("K-Means")
k_means = KMeansClustering(TrainingInputs=flip, OfClusters=cluster_2, RandomSeed=seed_2)  # -> Result, Likelihood, Centroids
k_means_2 = KMeansClustering(TrainingInputs=flip_2, OfClusters=cluster_2, RandomSeed=seed_2)  # -> Result, Likelihood, Centroids
k_means_3 = KMeansClustering(TrainingInputs=flip_3, OfClusters=cluster_2, RandomSeed=seed_2)  # -> Result, Likelihood, Centroids
k_means_4 = KMeansClustering(TrainingInputs=flip_4, OfClusters=cluster_2, RandomSeed=seed_2)  # -> Result, Likelihood, Centroids
k_means_5 = KMeansClustering(TrainingInputs=flip_5, OfClusters=cluster_2, RandomSeed=seed_2)  # -> Result, Likelihood, Centroids
k_means_6 = KMeansClustering(TrainingInputs=flip_6, OfClusters=cluster_2, RandomSeed=seed_2)  # -> Result, Likelihood, Centroids

# ----
geo_9 = Geometry(panel_4.L0)
geo_10 = Geometry(panel_4.L1)
geo_11 = Geometry(panel_4.L2)
geo_12 = Geometry(panel_4.L3)
geo_13 = Geometry(panel_4.L4)
geo_14 = Geometry(panel_4.L5)
xy = XYPlane(Origin=geo_7)
xy_2 = XYPlane(Origin=geo_8)
sph = Sphere(Base=xy, Radius=1)
sph_2 = Sphere(Base=xy_2, Radius=1)

# ---- group: Colorant 0
data_2 = Data(k_means.Result)
cset = CreateSet(List=data_2)  # -> Set, Map
lng_2 = ListLength(List=cset.Set)
gradient = Gradient(LowerLimit=0, UpperLimit=lng_2, Parameter=cset.Map, stops=[0: RGB(0, 128, 0), 0.5: RGB(255, 255, 0), 1: RGB(255, 0, 0)])
argb = SplitARGB(Colour=gradient, IntegerChannels=True)  # -> Alpha, Red, Green, Blue
rgb = ColourRGB(Alpha=255, Red=argb.Red, Green=argb.Green, Blue=argb.Blue)
preview = CustomPreview(Geometry=sph, Shader=rgb)  # disabled

data_3 = Data(k_means.Result)
cset_2 = CreateSet(List=data_3)  # -> Set, Map
lng_3 = ListLength(List=cset_2.Set)
gradient_2 = Gradient(
    LowerLimit=0,
    UpperLimit=lng_3,
    Parameter=cset_2.Map,
    stops=[0: RGB(0, 128, 0), 0.5: RGB(255, 255, 0), 1: RGB(255, 0, 0)])
argb_2 = SplitARGB(Colour=gradient_2, IntegerChannels=True)  # -> Alpha, Red, Green, Blue
rgb_2 = ColourRGB(Alpha=255, Red=argb_2.Red, Green=argb_2.Green, Blue=argb_2.Blue)
preview_2 = CustomPreview(Geometry=geo_7, Shader=rgb_2)

data_4 = Data(gaussianmix_3.Result)
cset_3 = CreateSet(List=data_4)  # -> Set, Map
lng_4 = ListLength(List=cset_3.Set)
gradient_3 = Gradient(
    LowerLimit=0,
    UpperLimit=lng_4,
    Parameter=cset_3.Map,
    stops=[0: RGB(64, 224, 208), 0.5: RGB(255, 215, 0), 1: RGB(255, 140, 0)])
argb_3 = SplitARGB(Colour=gradient_3, IntegerChannels=True)  # -> Alpha, Red, Green, Blue
rgb_3 = ColourRGB(Alpha=255, Red=argb_3.Red, Green=argb_3.Green, Blue=argb_3.Blue)

# ----
item_20 = ListItem(List=rgb_3, Index=series, Wrap=True)

# ---- group: Colorant 0 (continued)
preview_3 = CustomPreview(Geometry=geo_3, Shader=item_20)

data_5 = Data(gaussianmix.Result)
cset_4 = CreateSet(List=data_5)  # -> Set, Map
lng_5 = ListLength(List=cset_4.Set)
gradient_4 = Gradient(
    LowerLimit=0,
    UpperLimit=lng_5,
    Parameter=cset_4.Map,
    stops=[0: RGB(64, 224, 208), 0.5: RGB(255, 215, 0), 1: RGB(255, 140, 0)])
argb_4 = SplitARGB(Colour=gradient_4, IntegerChannels=True)  # -> Alpha, Red, Green, Blue
rgb_4 = ColourRGB(Alpha=255, Red=argb_4.Red, Green=argb_4.Green, Blue=argb_4.Blue)

# ----
item_21 = ListItem(List=rgb_4, Index=series, Wrap=True)

# ---- group: Colorant 0 (continued)
preview_4 = CustomPreview(Geometry=geo, Shader=item_21)

data_6 = Data(gaussianmix_2.Result)
cset_5 = CreateSet(List=data_6)  # -> Set, Map
lng_6 = ListLength(List=cset_5.Set)
gradient_5 = Gradient(
    LowerLimit=0,
    UpperLimit=lng_6,
    Parameter=cset_5.Map,
    stops=[0: RGB(64, 224, 208), 0.5: RGB(255, 215, 0), 1: RGB(255, 140, 0)])
argb_5 = SplitARGB(Colour=gradient_5, IntegerChannels=True)  # -> Alpha, Red, Green, Blue
rgb_5 = ColourRGB(Alpha=255, Red=argb_5.Red, Green=argb_5.Green, Blue=argb_5.Blue)

# ----
item_22 = ListItem(List=rgb_5, Index=series, Wrap=True)

# ---- group: Colorant 0 (continued)
preview_5 = CustomPreview(Geometry=geo_2, Shader=item_22)

data_7 = Data(gaussianmix_6.Result)
cset_6 = CreateSet(List=data_7)  # -> Set, Map
lng_7 = ListLength(List=cset_6.Set)
gradient_6 = Gradient(
    LowerLimit=0,
    UpperLimit=lng_7,
    Parameter=cset_6.Map,
    stops=[0: RGB(64, 224, 208), 0.5: RGB(255, 215, 0), 1: RGB(255, 140, 0)])
argb_6 = SplitARGB(Colour=gradient_6, IntegerChannels=True)  # -> Alpha, Red, Green, Blue
rgb_6 = ColourRGB(Alpha=255, Red=argb_6.Red, Green=argb_6.Green, Blue=argb_6.Blue)

# ----
item_23 = ListItem(List=rgb_6, Index=series, Wrap=True)

# ---- group: Colorant 0 (continued)
preview_6 = CustomPreview(Geometry=geo_6, Shader=item_23)

data_8 = Data(gaussianmix_5.Result)
cset_7 = CreateSet(List=data_8)  # -> Set, Map
lng_8 = ListLength(List=cset_7.Set)
gradient_7 = Gradient(
    LowerLimit=0,
    UpperLimit=lng_8,
    Parameter=cset_7.Map,
    stops=[0: RGB(64, 224, 208), 0.5: RGB(255, 215, 0), 1: RGB(255, 140, 0)])
argb_7 = SplitARGB(Colour=gradient_7, IntegerChannels=True)  # -> Alpha, Red, Green, Blue
rgb_7 = ColourRGB(Alpha=255, Red=argb_7.Red, Green=argb_7.Green, Blue=argb_7.Blue)

# ----
item_24 = ListItem(List=rgb_7, Index=series, Wrap=True)

# ---- group: Colorant 0 (continued)
preview_7 = CustomPreview(Geometry=geo_5, Shader=item_24)

data_9 = Data(gaussianmix_4.Result)
cset_8 = CreateSet(List=data_9)  # -> Set, Map
lng_9 = ListLength(List=cset_8.Set)
gradient_8 = Gradient(
    LowerLimit=0,
    UpperLimit=lng_9,
    Parameter=cset_8.Map,
    stops=[0: RGB(64, 224, 208), 0.5: RGB(255, 215, 0), 1: RGB(255, 140, 0)])
argb_8 = SplitARGB(Colour=gradient_8, IntegerChannels=True)  # -> Alpha, Red, Green, Blue
rgb_8 = ColourRGB(Alpha=255, Red=argb_8.Red, Green=argb_8.Green, Blue=argb_8.Blue)

# ----
item_25 = ListItem(List=rgb_8, Index=series, Wrap=True)

# ---- group: Colorant 0 (continued)
preview_8 = CustomPreview(Geometry=geo_4, Shader=item_25)

data_10 = Data(k_means.Result)
cset_9 = CreateSet(List=data_10)  # -> Set, Map
lng_10 = ListLength(List=cset_9.Set)
gradient_9 = Gradient(
    LowerLimit=0,
    UpperLimit=lng_10,
    Parameter=cset_9.Map,
    stops=[0: RGB(64, 224, 208), 0.5: RGB(255, 215, 0), 1: RGB(255, 140, 0)])

# ----
item_26 = ListItem(List=gradient_9, Index=series, Wrap=True)

# ---- group: Colorant 0 (continued)
argb_9 = SplitARGB(Colour=item_26, IntegerChannels=True)  # -> Alpha, Red, Green, Blue
rgb_9 = ColourRGB(Alpha=remap255, Red=argb_9.Red, Green=argb_9.Green, Blue=argb_9.Blue)
preview_9 = CustomPreview(Geometry=geo_9, Shader=rgb_9)

data_11 = Data(k_means_2.Result)
cset_10 = CreateSet(List=data_11)  # -> Set, Map
lng_11 = ListLength(List=cset_10.Set)
gradient_10 = Gradient(
    LowerLimit=0,
    UpperLimit=lng_11,
    Parameter=cset_10.Map,
    stops=[0: RGB(64, 224, 208), 0.5: RGB(255, 215, 0), 1: RGB(255, 140, 0)])

# ----
item_27 = ListItem(List=gradient_10, Index=series, Wrap=True)

# ---- group: Colorant 0 (continued)
argb_10 = SplitARGB(Colour=item_27, IntegerChannels=True)  # -> Alpha, Red, Green, Blue
rgb_10 = ColourRGB(Alpha=remap255_2, Red=argb_10.Red, Green=argb_10.Green, Blue=argb_10.Blue)
preview_10 = CustomPreview(Geometry=geo_10, Shader=rgb_10)

data_12 = Data(k_means_3.Result)
cset_11 = CreateSet(List=data_12)  # -> Set, Map
lng_12 = ListLength(List=cset_11.Set)
gradient_11 = Gradient(
    LowerLimit=0,
    UpperLimit=lng_12,
    Parameter=cset_11.Map,
    stops=[0: RGB(64, 224, 208), 0.5: RGB(255, 215, 0), 1: RGB(255, 140, 0)])

# ----
item_28 = ListItem(List=gradient_11, Index=series, Wrap=True)

# ---- group: Colorant 0 (continued)
argb_11 = SplitARGB(Colour=item_28, IntegerChannels=True)  # -> Alpha, Red, Green, Blue
rgb_11 = ColourRGB(Alpha=remap255_3, Red=argb_11.Red, Green=argb_11.Green, Blue=argb_11.Blue)
preview_11 = CustomPreview(Geometry=geo_11, Shader=rgb_11)

data_13 = Data(k_means_5.Result)
cset_12 = CreateSet(List=data_13)  # -> Set, Map
lng_13 = ListLength(List=cset_12.Set)
gradient_12 = Gradient(
    LowerLimit=0,
    UpperLimit=lng_13,
    Parameter=cset_12.Map,
    stops=[0: RGB(64, 224, 208), 0.5: RGB(255, 215, 0), 1: RGB(255, 140, 0)])

# ----
item_29 = ListItem(List=gradient_12, Index=series, Wrap=True)

# ---- group: Colorant 0 (continued)
argb_12 = SplitARGB(Colour=item_29, IntegerChannels=True)  # -> Alpha, Red, Green, Blue
rgb_12 = ColourRGB(Alpha=remap255_5, Red=argb_12.Red, Green=argb_12.Green, Blue=argb_12.Blue)
preview_12 = CustomPreview(Geometry=geo_13, Shader=rgb_12)

data_14 = Data(k_means_6.Result)
cset_13 = CreateSet(List=data_14)  # -> Set, Map
lng_14 = ListLength(List=cset_13.Set)
gradient_13 = Gradient(
    LowerLimit=0,
    UpperLimit=lng_14,
    Parameter=cset_13.Map,
    stops=[0: RGB(64, 224, 208), 0.5: RGB(255, 215, 0), 1: RGB(255, 140, 0)])

# ----
item_30 = ListItem(List=gradient_13, Index=series, Wrap=True)

# ---- group: Colorant 0 (continued)
argb_13 = SplitARGB(Colour=item_30, IntegerChannels=True)  # -> Alpha, Red, Green, Blue
rgb_13 = ColourRGB(Alpha=remap255_6, Red=argb_13.Red, Green=argb_13.Green, Blue=argb_13.Blue)
preview_13 = CustomPreview(Geometry=geo_14, Shader=rgb_13)

data_15 = Data(k_means_4.Result)
cset_14 = CreateSet(List=data_15)  # -> Set, Map
lng_15 = ListLength(List=cset_14.Set)
gradient_14 = Gradient(
    LowerLimit=0,
    UpperLimit=lng_15,
    Parameter=cset_14.Map,
    stops=[0: RGB(64, 224, 208), 0.5: RGB(255, 215, 0), 1: RGB(255, 140, 0)])

# ----
item_31 = ListItem(List=gradient_14, Index=series, Wrap=True)

# ---- group: Colorant 0 (continued)
argb_14 = SplitARGB(Colour=item_31, IntegerChannels=True)  # -> Alpha, Red, Green, Blue
rgb_14 = ColourRGB(Alpha=remap255_4, Red=argb_14.Red, Green=argb_14.Green, Blue=argb_14.Blue)
preview_14 = CustomPreview(Geometry=geo_12, Shader=rgb_14)

data_16 = Data(k_means.Result)
cset_15 = CreateSet(List=data_16)  # -> Set, Map
lng_16 = ListLength(List=cset_15.Set)
gradient_15 = Gradient(
    LowerLimit=0,
    UpperLimit=lng_16,
    Parameter=cset_15.Map,
    stops=[0: RGB(0, 128, 0), 0.5: RGB(255, 255, 0), 1: RGB(255, 0, 0)])

# ----
item_32 = ListItem(List=gradient_15, Index=series, Wrap=True)

# ---- group: Colorant 0 (continued)
argb_15 = SplitARGB(Colour=item_32, IntegerChannels=True)  # -> Alpha, Red, Green, Blue
rgb_15 = ColourRGB(Alpha=255, Red=argb_15.Red, Green=argb_15.Green, Blue=argb_15.Blue)
preview_15 = CustomPreview(Geometry=sph_2, Shader=rgb_15)  # disabled
